# Grasshopper definition adaptive_envelope_grasshopper.gh (Grasshopper 1.0.7)
# plug-ins: ClimateStudioGH, CORE.Grasshopper.Colibri, LadybugGrasshopper

panel = Panel("https://climate.onebuilding.org/WMO_Region_4_North_and_Central_America/USA_United_States_of_America/AZ_Arizona/USA_AZ_Scottsdale.AP.722789_TMYx.zip")
downloadepw = LBDownloadWeather(weather_URL=panel)  # -> epw_file, stat_file, ddy_file; plug-in component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
pt = Point(Point(-0.3412080519, 114.863195, 0))
legendpar = LBLegendParameters(min="0", max="900")  # -> leg_par; plug-in component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
legendpar_2 = LBLegendParameters(min="0", max="40")  # -> leg_par; plug-in component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
importepw = LBImportEPW(epw_file=downloadepw.epw_file)  # -> location, dry_bulb_temperature, dew_point_temperature, relative_humidity, wind_speed, wind_direction, direct_normal_rad, diffuse_horizontal_rad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; plug-in component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
pt_2 = Point(Point(-3, 103, 0))
hourlyplot = LBHourlyPlot(data=importepw.direct_normal_rad, base_pt=pt_2, legend_par=legendpar)  # -> report, mesh, legend, borders, labels, title, vis_set; plug-in component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

# ----
# CLOSE ALL
# 1 FACADE OPEN DAYTIME
#  FOR DIRECT SUN
temp_1 = ValueList({"5", "6", "7", "8"}, selected="5")
# CLOSE ALL
temp_3 = ValueList({"25", "26", "27", "28"}, selected="27")
# 2 FACADE OPEN DAYTIME
# FOR INDIRECT SUN
# 3 FACADE OPEN NIGHTIME
# FOR NATURAL VENTILATION
temp_2 = ValueList({"17", "18", "19", "20"}, selected="20")

xdata = LBDeconstructData(data=importepw.diffuse_horizontal_rad)  # -> header, values; plug-in component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
xdata_2 = LBDeconstructData(data=importepw.dry_bulb_temperature)  # -> header, values; plug-in component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
analysisperiod = LBAnalysisPeriod(start_month="5", start_day=1, start_hour=0, end_month="10")  # -> period, hoys, dates; plug-in component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
hourlyplot_2 = LBHourlyPlot(data=importepw.dry_bulb_temperature, base_pt=pt, legend_par=legendpar_2)  # -> report, mesh, legend, borders, labels, title, vis_set; plug-in component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
# with radiation
larger_than = LargerThan(FirstNumber=xdata.values, SecondNumber="1")  # -> LargerThan, OrEqualTo
larger_than_2 = LargerThan(FirstNumber=xdata_2.values, SecondNumber="22")  # -> LargerThan, OrEqualTo
# with no radiation
smaller = SmallerThan(FirstNumber=xdata.values, SecondNumber="1")  # -> SmallerThan, OrEqualTo
smaller_2 = SmallerThan(FirstNumber=xdata_2.values, SecondNumber="22")  # -> SmallerThan, OrEqualTo
num = Number(smaller.SmallerThan)
panel_2 = Panel(xdata_2.values)
num_2 = Number(smaller_2.SmallerThan)
number = Number(larger_than_2.OrEqualTo)
num_3 = Number(larger_than.OrEqualTo)

# ----
# EAST SCHEDULE
panel_3 = Panel("8760")
series = Series(Start="0", Step=1, Count=panel_3)
series_2 = Series(Start="0", Step=1, Count="8760")
xdata_3 = LBDeconstructData(data=importepw.dry_bulb_temperature)  # -> header, values; plug-in component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
mod = Modulus(A=series, B="24")
xdata_4 = LBDeconstructData(data=importepw.dry_bulb_temperature)  # -> header, values; plug-in component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
mod_2 = Modulus(A=series_2, B="24")
xdata_5 = LBDeconstructData(data=importepw.dry_bulb_temperature)  # -> header, values; plug-in component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
smaller_3 = SmallerThan(FirstNumber=xdata_3.values, SecondNumber=temp_2)  # -> SmallerThan, OrEqualTo
larger = LargerThan(FirstNumber=xdata_3.values, SecondNumber=temp_1)  # -> LargerThan, OrEqualTo
smaller_4 = SmallerThan(FirstNumber=mod, SecondNumber="10")  # -> SmallerThan, OrEqualTo
larger_2 = LargerThan(FirstNumber=mod, SecondNumber="10")  # -> LargerThan, OrEqualTo
larger_3 = LargerThan(FirstNumber=xdata_4.values, SecondNumber=temp_2)  # -> LargerThan, OrEqualTo
smaller_5 = SmallerThan(FirstNumber=xdata_4.values, SecondNumber=temp_3)  # -> SmallerThan, OrEqualTo
num_4 = Number(smaller_4.OrEqualTo)
num_5 = Number(larger_2.LargerThan)
smaller_6 = SmallerThan(FirstNumber=mod_2, SecondNumber="12")  # -> SmallerThan, OrEqualTo
number_2 = Number(larger.OrEqualTo)
number_3 = Number(smaller_3.SmallerThan)
multiplication = Multiplication(A=num, B=num_4)
number_4 = Number(smaller_5.SmallerThan)
number_5 = Number(larger_3.OrEqualTo)
larger_4 = LargerThan(FirstNumber=xdata_5.values, SecondNumber=temp_3)  # -> LargerThan, OrEqualTo
smaller_7 = SmallerThan(FirstNumber=xdata_5.values, SecondNumber=temp_1)  # -> SmallerThan, OrEqualTo
addition = Addition(A=multiplication, B=num_5)
num_6 = Number(smaller_6.OrEqualTo)
multiplication_2 = Multiplication(A=addition, B=number_2, C=number_3)
number_6 = Number(smaller_7.SmallerThan)
number_7 = Number(larger_4.OrEqualTo)
multiplication_3 = Multiplication(A=num_3, B=num_6, C=number_5, D=number_4)
addition_2 = Addition(A=multiplication_3, C=multiplication_2, D=number_7, E=number_6)
mass_addition = MassAddition(Input=addition_2)  # -> Result, PartialResults
panel_4 = Panel(addition_2)
hours_in_year = Panel(mass_addition.Result)
smaller_8 = SmallerThan(FirstNumber=addition_2, SecondNumber="0.5")  # -> SmallerThan, OrEqualTo
number_8 = Number(smaller_8.SmallerThan)
year_schedule = ConstructCSYearSchedule(Name="EAST", Type=0, Category=0, DaysHours=panel_4)  # -> Sched, Values
fixedintervalschedule = HBFixedIntervalSchedule(values=addition_2, type_limit="On-Off")  # -> report, schedule; plug-in component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
division = Division(A=hours_in_year, B="8760")
panel_5 = Panel(number_8)
panel_6 = Panel(division)
fixedintervalschedule_2 = HBFixedIntervalSchedule(values=number_8, type_limit="On-Off")  # -> report, schedule; plug-in component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

# ----
# WEST SCHEDULE
panel_7 = Panel("8760")
xdata_6 = LBDeconstructData(data=importepw.dry_bulb_temperature)  # -> header, values; plug-in component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
series_3 = Series(Start="0", Step=1, Count=panel_7)
xdata_7 = LBDeconstructData(data=importepw.dry_bulb_temperature)  # -> header, values; plug-in component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
series_4 = Series(Start="0", Step=1, Count="8760")
xdata_8 = LBDeconstructData(data=importepw.dry_bulb_temperature)  # -> header, values; plug-in component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
mod_3 = Modulus(A=series_3, B="24")
mod_4 = Modulus(A=series_4, B="24")
smaller_9 = SmallerThan(FirstNumber=xdata_6.values, SecondNumber=temp_2)  # -> SmallerThan, OrEqualTo
larger_5 = LargerThan(FirstNumber=xdata_6.values, SecondNumber=temp_1)  # -> LargerThan, OrEqualTo
larger_6 = LargerThan(FirstNumber=mod_3, SecondNumber="14")  # -> LargerThan, OrEqualTo
smaller_10 = SmallerThan(FirstNumber=mod_3, SecondNumber="14")  # -> SmallerThan, OrEqualTo
larger_7 = LargerThan(FirstNumber=xdata_8.values, SecondNumber=temp_2)  # -> LargerThan, OrEqualTo
smaller_11 = SmallerThan(FirstNumber=xdata_8.values, SecondNumber=temp_3)  # -> SmallerThan, OrEqualTo
num_7 = Number(larger_6.LargerThan)
larger_8 = LargerThan(FirstNumber=mod_4, SecondNumber="12")  # -> LargerThan, OrEqualTo
number_9 = Number(larger_5.OrEqualTo)
number_10 = Number(smaller_9.SmallerThan)
multiplication_4 = Multiplication(A=num, B=num_7)
num_8 = Number(smaller_10.OrEqualTo)
number_11 = Number(smaller_11.SmallerThan)
number_12 = Number(larger_7.OrEqualTo)
addition_3 = Addition(A=multiplication_4, B=num_8)
num_9 = Number(larger_8.OrEqualTo)
larger_9 = LargerThan(FirstNumber=xdata_7.values, SecondNumber=temp_3)  # -> LargerThan, OrEqualTo
smaller_12 = SmallerThan(FirstNumber=xdata_7.values, SecondNumber=temp_1)  # -> SmallerThan, OrEqualTo
multiplication_5 = Multiplication(A=num_3, B=num_9, C=number_12, D=number_11)
multiplication_6 = Multiplication(A=addition_3, B=number_9, C=number_10)
number_13 = Number(smaller_12.SmallerThan)
number_14 = Number(larger_9.OrEqualTo)
addition_4 = Addition(A=multiplication_5, C=multiplication_6, D=number_14, E=number_13)
mass_addition_2 = MassAddition(Input=addition_4)  # -> Result, PartialResults
panel_8 = Panel(addition_4)
hours_in_year_2 = Panel(mass_addition_2.Result)
smaller_13 = SmallerThan(FirstNumber=addition_4, SecondNumber="0.5")  # -> SmallerThan, OrEqualTo
year_schedule_2 = ConstructCSYearSchedule(Name="WEST", Type=0, Category=0, DaysHours=panel_8)  # -> Sched, Values
number_15 = Number(smaller_13.SmallerThan)
fixedintervalschedule_3 = HBFixedIntervalSchedule(values=addition_4, type_limit="On-Off")  # -> report, schedule; plug-in component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
division_2 = Division(A=hours_in_year_2, B="8760")
panel_9 = Panel(number_15)
panel_10 = Panel(division_2)
fixedintervalschedule_4 = HBFixedIntervalSchedule(values=number_15, type_limit="On-Off")  # -> report, schedule; plug-in component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

# ----
# SOUTH SCHEDULE
panel_11 = Panel("8760")
xdata_9 = LBDeconstructData(data=importepw.dry_bulb_temperature)  # -> header, values; plug-in component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
series_5 = Series(Start="0", Step=1, Count=panel_11)
mod_5 = Modulus(A=series_5, B="24")
xdata_10 = LBDeconstructData(data=importepw.dry_bulb_temperature)  # -> header, values; plug-in component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
smaller_14 = SmallerThan(FirstNumber=xdata_9.values, SecondNumber=temp_2)  # -> SmallerThan, OrEqualTo
larger_10 = LargerThan(FirstNumber=xdata_9.values, SecondNumber=temp_1)  # -> LargerThan, OrEqualTo
smaller_15 = SmallerThan(FirstNumber=mod_5, SecondNumber="10")  # -> SmallerThan, OrEqualTo
larger_11 = LargerThan(FirstNumber=mod_5, SecondNumber="14")  # -> LargerThan, OrEqualTo
num_10 = Number(smaller_15.SmallerThan)
num_11 = Number(larger_11.LargerThan)
number_16 = Number(larger_10.OrEqualTo)
number_17 = Number(smaller_14.SmallerThan)
larger_12 = LargerThan(FirstNumber=xdata_10.values, SecondNumber=temp_2)  # -> LargerThan, OrEqualTo
smaller_16 = SmallerThan(FirstNumber=xdata_10.values, SecondNumber=temp_1)  # -> SmallerThan, OrEqualTo
addition_5 = Addition(A=num_10, B=num_11)
multiplication_7 = Multiplication(A=num, B=number_16, C=number_17)
number_18 = Number(smaller_16.SmallerThan)
number_19 = Number(larger_12.OrEqualTo)
addition_6 = Addition(C=multiplication_7, D=number_19, E=number_18)
mass_addition_3 = MassAddition(Input=addition_6)  # -> Result, PartialResults
panel_12 = Panel(addition_6)
hours_in_year_3 = Panel(mass_addition_3.Result)
smaller_17 = SmallerThan(FirstNumber=addition_6, SecondNumber="0.5")  # -> SmallerThan, OrEqualTo
number_20 = Number(smaller_17.SmallerThan)
year_schedule_3 = ConstructCSYearSchedule(Name="SOUTH", Type=0, Category=0, DaysHours=panel_12)  # -> Sched, Values
fixedintervalschedule_5 = HBFixedIntervalSchedule(values=addition_6, type_limit="On-Off")  # -> report, schedule; plug-in component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
division_3 = Division(A=hours_in_year_3, B="8760")
panel_13 = Panel(number_20)
panel_14 = Panel(division_3)
fixedintervalschedule_6 = HBFixedIntervalSchedule(values=number_20, type_limit="On-Off")  # -> report, schedule; plug-in component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

# ----
# NORTH SCHEDULE
xdata_11 = LBDeconstructData(data=importepw.dry_bulb_temperature)  # -> header, values; plug-in component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
larger_13 = LargerThan(FirstNumber=xdata_11.values, SecondNumber=temp_3)  # -> LargerThan, OrEqualTo
smaller_18 = SmallerThan(FirstNumber=xdata_11.values, SecondNumber=temp_2)  # -> SmallerThan, OrEqualTo
number_21 = Number(smaller_18.OrEqualTo)
number_22 = Number(larger_13.OrEqualTo)
addition_7 = Addition(A=number_22, B=number_21)
mass_addition_4 = MassAddition(Input=addition_7)  # -> Result, PartialResults
panel_15 = Panel(addition_7)
hours_in_year_4 = Panel(mass_addition_4.Result)
fixedintervalschedule_7 = HBFixedIntervalSchedule(values=addition_7, type_limit="On-Off")  # -> report, schedule; plug-in component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
year_schedule_4 = ConstructCSYearSchedule(Name="NORTH", Type=0, Category=0, DaysHours=addition_7)  # -> Sched, Values
smaller_19 = SmallerThan(FirstNumber=addition_7, SecondNumber="0.5")  # -> SmallerThan, OrEqualTo
number_23 = Number(smaller_19.SmallerThan)
panel_16 = Panel(number_23)
fixedintervalschedule_8 = HBFixedIntervalSchedule(values=panel_16, type_limit="On-Off")  # -> report, schedule; plug-in component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

multiplication_8 = Multiplication(A=number, B=num)
smaller_20 = SmallerThan(FirstNumber=multiplication_8, SecondNumber="0.5")  # -> SmallerThan, OrEqualTo

multiplication_9 = Multiplication(A=num_2, B=num_3)
multiplication_10 = Multiplication(A=number, B=num)
addition_8 = Addition(A=multiplication_10, B=multiplication_9)
smaller_21 = SmallerThan(FirstNumber=addition_8, SecondNumber="0.5")  # -> SmallerThan, OrEqualTo
fixedintervalschedule_9 = HBFixedIntervalSchedule(values=addition_8, type_limit="On-Off")  # -> report, schedule; plug-in component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
number_24 = Number(smaller_21.SmallerThan)
panel_17 = Panel(number_24)
year_schedule_5 = ConstructCSYearSchedule(Name="close", Type=0, Category=0, DaysHours=number_24)  # -> Sched, Values
fixedintervalschedule_10 = HBFixedIntervalSchedule(values=panel_17, type_limit="On-Off")  # -> report, schedule; plug-in component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
geo = Geometry([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])
geo_2 = Geometry(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)
shade = HBShade(geo=geo)  # -> report, shades; plug-in component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
shade_2 = HBShade(geo=geo_2, ep_trans_sch=fixedintervalschedule_10.schedule)  # -> report, shades; plug-in component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

number_25 = Number(smaller_20.SmallerThan)
year_schedule_6 = ConstructCSYearSchedule(Name="PV", Type=0, Category=0, DaysHours=number_25)  # -> Sched, Values

# ----
# WEST OPEN
value_list = ValueList({"90"}, selected="90")
multiplication_11 = Multiplication(A=value_list, B="1/180")
geometry = Geometry(graft([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]))
pi = Pi(Factor=multiplication_11)
deconstruct_brep = DeconstructBrep(Brep=geometry)  # -> Faces, Edges, Vertices
list_item = ListItem(List=deconstruct_brep.Faces, Index=Slider(3, range=0..10), Wrap=True)
list_item_2 = ListItem(List=deconstruct_brep.Faces, Index=Slider(5, range=0..10), Wrap=True)
area = Area(Geometry=list_item)  # -> Area, Centroid
area_2 = Area(Geometry=list_item_2)  # -> Area, Centroid
line = Line(StartPoint=area.Centroid, EndPoint=area_2.Centroid)
rotate_axis = RotateAxis(Geometry=geometry, Angle=pi, Axis=line)  # -> Geometry, Transform
geometry_2 = Geometry(rotate_axis.Geometry)
shade_3 = HBShade(geo=geometry_2)  # -> report, shades; plug-in component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

# ----
# NORTH OPEN
value_list_2 = ValueList({"90"}, selected="90")
multiplication_12 = Multiplication(A=value_list_2, B="1/180")
geometry_3 = Geometry(graft([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]))
pi_2 = Pi(Factor=multiplication_12)
deconstruct_brep_2 = DeconstructBrep(Brep=geometry_3)  # -> Faces, Edges, Vertices
list_item_3 = ListItem(List=deconstruct_brep_2.Faces, Index=Slider(5, range=0..10), Wrap=True)
list_item_4 = ListItem(List=deconstruct_brep_2.Faces, Index=Slider(3, range=0..10), Wrap=True)
area_3 = Area(Geometry=list_item_4)  # -> Area, Centroid
area_4 = Area(Geometry=list_item_3)  # -> Area, Centroid
line_2 = Line(StartPoint=area_3.Centroid, EndPoint=area_4.Centroid)
rotate_axis_2 = RotateAxis(Geometry=geometry_3, Angle=pi_2, Axis=line_2)  # -> Geometry, Transform
geometry_4 = Geometry(rotate_axis_2.Geometry)
shade_4 = HBShade(geo=geometry_4)  # -> report, shades; plug-in component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

# ----
# EAST CLOSE
value_list_3 = ValueList({"90"}, selected="90")
multiplication_13 = Multiplication(A=value_list_3, B="1/180")
geometry_5 = Geometry(graft([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]))
pi_3 = Pi(Factor=multiplication_13)
deconstruct_brep_3 = DeconstructBrep(Brep=geometry_5)  # -> Faces, Edges, Vertices
list_item_5 = ListItem(List=deconstruct_brep_3.Faces, Index=Slider(3, range=0..10), Wrap=True)
list_item_6 = ListItem(List=deconstruct_brep_3.Faces, Index=Slider(5, range=0..10), Wrap=True)
area_5 = Area(Geometry=list_item_5)  # -> Area, Centroid
area_6 = Area(Geometry=list_item_6)  # -> Area, Centroid
line_3 = Line(StartPoint=area_5.Centroid, EndPoint=area_6.Centroid)
rotate_axis_3 = RotateAxis(Geometry=geometry_5, Angle=pi_3, Axis=line_3)  # -> Geometry, Transform
geometry_6 = Geometry(rotate_axis_3.Geometry)
shade_5 = HBShade(geo=geometry_6)  # -> report, shades; plug-in component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

# ----
# EAST OPEN
panel_18 = Panel("0.2")
opaquematnomass = HBOpaqueMaterialNoMass(r_value="1", therm_absp=panel_18, sol_absp="0.2")  # -> mat; plug-in component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
opaqueconstr = HBOpaqueConstruction(materials=opaquematnomass)  # -> constr; plug-in component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
geo_3 = Geometry(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)
face = HBFace(geo=geo_3, type="Wall", bc="outdoors", ep_constr=opaqueconstr)  # -> report, faces; plug-in component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
value_list_4 = ValueList({"0.95"}, selected="0.95")
aperturesbyratio = HBAperturesByRatio(hb_objs=flatten(face.faces), ratio=value_list_4, operable=Toggle(True))  # -> report, hb_objs; plug-in component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
windowmat = HBWindowMaterial(u_factor="2", shgc="0.5")  # -> mat; plug-in component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
windowconstr = HBWindowConstruction(materials=windowmat)  # -> constr; plug-in component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
blindmat = HBBlindMaterial(
    vertical=Toggle(True),
    slat_width="1",
    slat_separation="1",
    slat_thickness="0.05",
    slat_angle="0",
    conductivity="0.00167",
    transmittance="0",
    reflectance="0.5",
    dist_to_glass="0.5")  # -> mat; plug-in component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
windowconstrshd = HBWindowConstructionShade(win_constr=windowconstr, shd_material=blindmat, shd_location="exterior", schedule=fixedintervalschedule.schedule)  # -> constr; plug-in component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
applywindowconstr = HBApplyWindowConstruction(hb_objs=flatten(aperturesbyratio.hb_objs), constr=windowconstrshd)  # -> hb_objs; plug-in component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

# ----
# SOUTH OPEN
value_list_5 = ValueList({"90"}, selected="90")
multiplication_14 = Multiplication(A=value_list_5, B="1/180")
geometry_7 = Geometry(graft([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]))
pi_4 = Pi(Factor=multiplication_14)
deconstruct_brep_4 = DeconstructBrep(Brep=geometry_7)  # -> Faces, Edges, Vertices
list_item_7 = ListItem(List=deconstruct_brep_4.Faces, Index=Slider(3, range=0..10), Wrap=True)
list_item_8 = ListItem(List=deconstruct_brep_4.Faces, Index=Slider(5, range=0..10), Wrap=True)
area_7 = Area(Geometry=list_item_7)  # -> Area, Centroid
area_8 = Area(Geometry=list_item_8)  # -> Area, Centroid
line_4 = Line(StartPoint=area_7.Centroid, EndPoint=area_8.Centroid)
rotate_axis_4 = RotateAxis(Geometry=geometry_7, Angle=pi_4, Axis=line_4)  # -> Geometry, Transform
geometry_8 = Geometry(rotate_axis_4.Geometry)
shade_6 = HBShade(geo=geometry_8)  # -> report, shades; plug-in component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

# ----
# WEST CLOSE
panel_19 = Panel("outdoors")
geo_4 = Geometry(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)
face_2 = HBFace(geo=geo_4, type="Wall", bc=panel_19, ep_constr=opaqueconstr)  # -> report, faces; plug-in component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
value_list_6 = ValueList({"0.95"}, selected="0.95")
aperturesbyratio_2 = HBAperturesByRatio(hb_objs=flatten(face_2.faces), ratio=value_list_6, operable=Toggle(True))  # -> report, hb_objs; plug-in component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
windowmat_2 = HBWindowMaterial(u_factor="2", shgc="0.5")  # -> mat; plug-in component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
windowconstr_2 = HBWindowConstruction(materials=windowmat_2)  # -> constr; plug-in component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
blindmat_2 = HBBlindMaterial(
    vertical=Toggle(True),
    slat_width="1",
    slat_separation="1",
    slat_thickness="0.05",
    slat_angle="0",
    conductivity="0.00167",
    transmittance="0",
    reflectance="0.5",
    dist_to_glass="0.5")  # -> mat; plug-in component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
windowconstrshd_2 = HBWindowConstructionShade(win_constr=windowconstr_2, shd_material=blindmat_2, shd_location="exterior", schedule=fixedintervalschedule_3.schedule)  # -> constr; plug-in component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
applywindowconstr_2 = HBApplyWindowConstruction(hb_objs=flatten(aperturesbyratio_2.hb_objs), constr=windowconstrshd_2)  # -> hb_objs; plug-in component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

# ----
# SOUTH CLOSE
panel_20 = Panel("outdoors")
geo_5 = Geometry(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)
face_3 = HBFace(geo=geo_5, type="Wall", bc=panel_20, ep_constr=opaqueconstr)  # -> report, faces; plug-in component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
value_list_7 = ValueList({"0.95"}, selected="0.95")
aperturesbyratio_3 = HBAperturesByRatio(hb_objs=flatten(face_3.faces), ratio=value_list_7, operable=Toggle(True))  # -> report, hb_objs; plug-in component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
windowmat_3 = HBWindowMaterial(u_factor="2", shgc="0.5")  # -> mat; plug-in component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
windowconstr_3 = HBWindowConstruction(materials=windowmat_3)  # -> constr; plug-in component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
blindmat_3 = HBBlindMaterial(
    vertical=Toggle(True),
    slat_width="1",
    slat_separation="1",
    slat_thickness="0.05",
    slat_angle="0",
    conductivity="0.00167",
    transmittance="0",
    reflectance="0.5",
    dist_to_glass="0.5")  # -> mat; plug-in component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
windowconstrshd_3 = HBWindowConstructionShade(win_constr=windowconstr_3, shd_material=blindmat_3, shd_location="exterior", schedule=fixedintervalschedule_5.schedule)  # -> constr; plug-in component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
applywindowconstr_3 = HBApplyWindowConstruction(hb_objs=flatten(aperturesbyratio_3.hb_objs), constr=windowconstrshd_3)  # -> hb_objs; plug-in component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

# ----
# NORTH CLOSE
panel_21 = Panel("outdoors")
geo_6 = Geometry(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)
face_4 = HBFace(geo=geo_6, type="Wall", bc=panel_21, ep_constr=opaqueconstr)  # -> report, faces; plug-in component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
value_list_8 = ValueList({"0.95"}, selected="0.95")
aperturesbyratio_4 = HBAperturesByRatio(hb_objs=flatten(face_4.faces), ratio=value_list_8, operable=Toggle(True))  # -> report, hb_objs; plug-in component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
windowmat_4 = HBWindowMaterial(u_factor="2", shgc="0.5")  # -> mat; plug-in component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
windowconstr_4 = HBWindowConstruction(materials=windowmat_4)  # -> constr; plug-in component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
blindmat_4 = HBBlindMaterial(
    vertical=Toggle(True),
    slat_width="1",
    slat_separation="1",
    slat_thickness="0.05",
    slat_angle="0",
    conductivity="0.00167",
    transmittance="0",
    reflectance="0.5",
    dist_to_glass="0.5")  # -> mat; plug-in component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
windowconstrshd_4 = HBWindowConstructionShade(win_constr=windowconstr_4, shd_material=blindmat_4, shd_location="exterior", schedule=fixedintervalschedule_7.schedule)  # -> constr; plug-in component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
applywindowconstr_4 = HBApplyWindowConstruction(hb_objs=flatten(aperturesbyratio_4.hb_objs), constr=windowconstrshd_4)  # -> hb_objs; plug-in component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

# ----
# FLOOR & CEILING & CORNERS
panel_22 = Panel("0.5")
opaquematnomass_2 = HBOpaqueMaterialNoMass(r_value="30", therm_absp="0.5", sol_absp=panel_22)  # -> mat; plug-in component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
opaquematnomass_3 = HBOpaqueMaterialNoMass(r_value="15", therm_absp="0.2", sol_absp="0.2")  # -> mat; plug-in component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
opaqueconstr_2 = HBOpaqueConstruction(materials=opaquematnomass_2)  # -> constr; plug-in component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
opaqueconstr_3 = HBOpaqueConstruction(materials=opaquematnomass_3)  # -> constr; plug-in component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
geo_7 = Geometry([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])
face_5 = HBFace(geo=geo_7, type="Wall", bc="outdoors", ep_constr=opaqueconstr_2)  # -> report, faces; plug-in component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
geo_8 = Geometry(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)
face_6 = HBFace(geo=geo_8, type="Roofceiling", bc="outdoors", ep_constr=opaqueconstr_3)  # -> report, faces; plug-in component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
value_list_9 = ValueList({"0.95"}, selected="0.95")
geo_9 = Geometry(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)
aperturesbyratio_5 = HBAperturesByRatio(hb_objs=flatten(face_5.faces), ratio=value_list_9, operable=Toggle(False))  # -> report, hb_objs; plug-in component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
face_7 = HBFace(geo=geo_9, type="floor", bc="adiabatic")  # -> report, faces; plug-in component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
windowmat_5 = HBWindowMaterial(u_factor="0.0333", shgc="0.2", t_vis="0.2")  # -> mat; plug-in component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
windowconstr_5 = HBWindowConstruction(materials=windowmat_5)  # -> constr; plug-in component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
applywindowconstr_5 = HBApplyWindowConstruction(hb_objs=flatten(aperturesbyratio_5.hb_objs), constr=windowconstr_5)  # -> hb_objs; plug-in component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

constrsetclimate = HBConstructionSetByClimate(climate_zone="2B")  # -> constr_set; plug-in component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
room = HBRoom(
    faces=flatten([face_7.faces, face_6.faces, applywindowconstr, applywindowconstr_3, applywindowconstr_2, applywindowconstr_4, applywindowconstr_5]),
    constr_set=constrsetclimate,
    conditioned=Toggle(True))  # -> report, room; plug-in component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

# ----
# ROOM SETTING
value_list_10 = ValueList({"1", "2", "3", "4", "5"}, selected="1")
ventcontrol = HBVentilationControl(min_in_temp="22", min_out_temp=temp_2, max_out_temp=temp_3, delta_temp=value_list_10)  # -> vent_cntrl; plug-in component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
geo_10 = Geometry(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)
shade_7 = HBShade(geo=geo_10)  # -> report, shades; plug-in component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
windowopen = HBWindowOpening(
    rooms=flatten(room.room),
    vent_cntrl=ventcontrol,
    fract_area_oper="0.5",
    discharge_coeff="0.2",
    wind_cross_vent=Toggle(True))  # -> report, rooms; plug-in component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
applyloadvals = HBApplyLoadValues(
    room_or_program=flatten(windowopen.rooms),
    people_per_floor="2/121",
    lighting_per_floor="2",
    electric_per_floor="2",
    hot_wtr_per_floor="0.1",
    vent_ach="0.1")  # -> report, mod_obj; plug-in component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

# ----
# WATER
opaquemat = HBOpaqueMaterial(thickness="0.1", conductivity="0.598", density="1000", spec_heat="4186")  # -> mat; plug-in component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
opaqueconstr_4 = HBOpaqueConstruction(materials=opaquemat)  # -> constr; plug-in component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
geo_11 = Geometry(<brep referenced from the Rhino model>)
internalmass = HBInternalMass(rooms=applyloadvals.mod_obj, geo_or_area=geo_11, construction=opaqueconstr_4)  # -> report, rooms; plug-in component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
model = HBModel(
    rooms=flatten(internalmass.rooms),
    shades=flatten([shade_7.shades, shade_4.shades, shade_3.shades, shade_5.shades, shade_6.shades]))  # -> report, model; plug-in component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
lb_falsestarttoggle = LBFalseStartToggle(False)

toggle = BooleanToggle(True)
simoutput = HBSimulationOutput(
    zone_energy_use=toggle,
    hvac_energy_use=toggle,
    gains_and_losses=toggle,
    comfort_metrics=toggle,
    surface_temperature=toggle,
    surface_energy_flow=toggle)  # -> report, sim_output; plug-in component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
panel_23 = Panel("https://climate.onebuilding.org/WMO_Region_4_North_and_Central_America/USA_United_States_of_America/AZ_Arizona/USA_AZ_Scottsdale.AP.722789_TMYx.zip")
downloadepw_2 = LBDownloadWeather(weather_URL=panel_23)  # -> epw_file, stat_file, ddy_file; plug-in component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
simpar = HBSimulationParameter(output=simoutput.sim_output, timestep=6)  # -> sim_par; plug-in component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
modeltoosm = HBModelToOSM(model=model.model, epw_file=downloadepw_2.epw_file, sim_par=simpar, write=lb_falsestarttoggle, run=lb_falsestarttoggle)  # -> report, jsons, osw, osm, idf, sql, zsz, rdd, html; plug-in component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
roomcomfortresult = HBReadRoomComfortResult(sql=modeltoosm.sql)  # -> oper_temp, air_temp, rad_temp, rel_humidity; plug-in component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

surface = Surface(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)
genpts = LBGeneratePointGrid(geometry=surface, grid_size="1")  # -> points, vectors, face_areas, mesh; plug-in component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

# ----
# PMV
toggle_2 = BooleanToggle(True)
pmv = LBPMVComfort(
    air_temp=roomcomfortresult.air_temp,
    mrt=roomcomfortresult.rad_temp,
    rel_humid=roomcomfortresult.rel_humidity,
    clothing="0.5",
    run=toggle_2)  # -> report, pmv, ppd, set, comfort, condition, heat_loss, comf_obj; plug-in component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
xdata_12 = LBDeconstructData(data=pmv.pmv)  # -> header, values; plug-in component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
pt_3 = Point(Point(-39, 200, 0))
hourlyplot_3 = LBHourlyPlot(data=pmv.pmv, base_pt=pt_3)  # -> report, mesh, legend, borders, labels, title; plug-in component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
smaller_22 = SmallerThan(FirstNumber=xdata_12.values, SecondNumber="1")  # -> SmallerThan, OrEqualTo
list_length = ListLength(List=xdata_12.values)
dispatch = Dispatch(List=xdata_12.values, DispatchPattern=smaller_22.OrEqualTo)  # -> ListA, ListB
larger_14 = LargerThan(FirstNumber=dispatch.ListA, SecondNumber="-1")  # -> LargerThan, OrEqualTo
list_length_2 = ListLength(List=larger_14.OrEqualTo)
division_4 = Division(A=list_length_2, B=list_length)
pmv_comfort = Panel(division_4)

# ----
# EUI
eui = HBEndUseIntensity(sql=modeltoosm.sql)  # -> eui, eui_end_use, end_uses, gross_floor; plug-in component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
panel_24 = Panel(eui.eui_end_use)
panel_25 = Panel(eui.gross_floor)
ma = MassAddition(Input=panel_24)  # -> Result, PartialResults
eui_2 = Panel(ma.Result)
multiplication_15 = Multiplication(A=eui_2, B=panel_25)
total_eui = Panel(multiplication_15)

# ----
# OPERATIVE TEMP
panel_26 = Panel("0")
legendpar_3 = LBLegendParameters(min=panel_26, max="40")  # -> leg_par; plug-in component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
pt_4 = Point(Point(-37.82676483, 57.50334652, 0))
xdata_13 = LBDeconstructData(data=roomcomfortresult.oper_temp)  # -> header, values; plug-in component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
panel_27 = Panel(xdata_13.values)
bounds = Bounds(Numbers=panel_27)
larger_than_3 = LargerThan(FirstNumber=panel_27, SecondNumber="20")  # -> LargerThan, OrEqualTo
smaller_than = SmallerThan(FirstNumber=panel_27, SecondNumber="28")  # -> SmallerThan, OrEqualTo
data = Data(bounds)
min_max_operative_t = Panel(data)
panel_28 = Panel(smaller_than.OrEqualTo)
panel_29 = Panel(larger_than_3.OrEqualTo)
number_26 = Number(panel_29)
number_27 = Number(panel_28)
panel_30 = Panel(number_26)
panel_31 = Panel(number_27)
deconstruct_domain = DeconstructDomain(Domain=min_max_operative_t)  # -> Start, End
multiplication_16 = Multiplication(A=panel_30, B=panel_31)
panel_32 = Panel(deconstruct_domain.Start)
panel_33 = Panel(deconstruct_domain.End)
ma_2 = MassAddition(Input=multiplication_16)  # -> Result, PartialResults
total_comfort_h = Panel(ma_2.Result)
division_5 = Division(A=total_comfort_h, B="8760")
temp_comfort = Panel(division_5)

sensorgrid = HBSensorGrid(positions=genpts.points, directions=genpts.vectors, mesh=genpts.mesh)  # -> grid; plug-in component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
lb_falsestarttoggle_2 = LBFalseStartToggle(False)

# ----
# UDI
assigngridsviews = HBAssignGridsAndViews(model=model.model, grids=flatten(sensorgrid))  # -> model; plug-in component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
annualdaylight = HBAnnualDaylight(model=assigngridsviews, wea=downloadepw_2.epw_file, run=lb_falsestarttoggle_2)  # -> report, results, DA, cDA, UDI, UDI_low, UDI_up; plug-in component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
avr = Average(Input=simplify(flatten(annualdaylight.UDI)))
average_udi = Panel(avr)

hourlyplot_4 = LBHourlyPlot(data=roomcomfortresult.oper_temp, base_pt=pt_4, legend_par=legendpar_3)  # -> out, mesh, legend, borders, labels, title; plug-in component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
legendpar_4 = LBLegendParameters(min="0", max="70")  # -> leg_par; plug-in component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
division_6 = Division(A="1", B=eui_2)
panel_34 = Panel(division_6)
heatmap = LBSpatialHeatmap(values=annualdaylight.UDI, mesh=genpts.mesh, legend_par=legendpar_4)  # -> mesh, legend, title, colors, legend_par; plug-in component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
panel_35 = Panel(annualdaylight.UDI)
adaptivemap = HBAdaptiveComfortMap(model=assigngridsviews, epw=downloadepw_2.epw_file, ddy=downloadepw_2.ddy_file)  # -> out, env_conds, op_temp, condition, deg_neut, TCP, HSP, CSP; plug-in component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
division_7 = Division(A="1", B=panel_33)
square = Square(Value=average_udi)
multiplication_17 = Multiplication(A=square, B=pmv_comfort, C=division_6, D=division_7, E=temp_comfort)

# ---- group: Colibri
number_slider = Slider(2500, range=0..2500)
colibri_inputs_iterator = ColibriInputsIterator(Temp_1=temp_1, Temp_2=temp_2, Temp_3=temp_3, ignoreAllWarningMsg=True)  # -> Unique_Name, Inputs, Temp_1, Temp_2, Temp_3
colibri_image_setting = ColibriImageSetting(ImageSaveAsName="defaultName", Width=number_slider, Height=number_slider)
colibri_outputs = ColibriOutputs(
    Average_UDI=flatten(average_udi),
    _1_highest_temp=flatten(division_7),
    PMV=flatten(pmv_comfort),
    _1_EUI=flatten(division_6),
    comfort=flatten(temp_comfort),
    Fitness=flatten(multiplication_17))
colibri_aggregator = ColibriAggregator(
    Folder="C:\Users\bzr96\OneDrive - PennO365\桌面\studio\test5",
    Inputs=colibri_inputs_iterator.Inputs,
    Outputs=colibri_outputs,
    ImageSetting=colibri_image_setting,
    Write=Toggle(False),
    recordingMode=0)
